# Grasshopper definition kit_of_parts.gh (Grasshopper 1.0.7)

brep = Brep(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)
brep_2 = Brep([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])
brep_3 = Brep([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])

brep_4 = Brep(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)
brep_5 = Brep([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])
brep_6 = Brep([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])

brep_7 = Brep(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)
brep_8 = Brep([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])
brep_9 = Brep([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])

brep_10 = Brep([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])
brep_11 = Brep([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])
brep_12 = Brep([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])
brep_13 = Brep([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])

brep_14 = Brep(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)
brep_15 = Brep([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])
brep_16 = Brep([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])

mesh_brep = MeshBrep(
    Brep=brep_8,
    Settings={GridMaxCount=0, GridMinCount=16, JaggedSeams=False, MaxEdgeLength=0, MinEdgeLength=0.0001, MinTolerance=0, Refine=True, RefineAngle=0, RelativeTolerance=0.65, SimplePlanes=True, Tolerance=0})
mesh_brep_2 = MeshBrep(
    Brep=brep_9,
    Settings={GridMaxCount=0, GridMinCount=16, JaggedSeams=False, MaxEdgeLength=0, MinEdgeLength=0.0001, MinTolerance=0, Refine=True, RefineAngle=0, RelativeTolerance=0.65, SimplePlanes=True, Tolerance=0})
mesh_brep_3 = MeshBrep(
    Brep=brep_7,
    Settings={GridMaxCount=0, GridMinCount=16, JaggedSeams=False, MaxEdgeLength=0, MinEdgeLength=0.0001, MinTolerance=0, Refine=True, RefineAngle=0, RelativeTolerance=0.65, SimplePlanes=True, Tolerance=0})
mesh_brep_4 = MeshBrep(
    Brep=brep_13,
    Settings={GridMaxCount=0, GridMinCount=16, JaggedSeams=False, MaxEdgeLength=0, MinEdgeLength=0.0001, MinTolerance=0, Refine=True, RefineAngle=0, RelativeTolerance=0.65, SimplePlanes=True, Tolerance=0})
mesh_brep_5 = MeshBrep(
    Brep=brep_12,
    Settings={GridMaxCount=0, GridMinCount=16, JaggedSeams=False, MaxEdgeLength=0, MinEdgeLength=0.0001, MinTolerance=0, Refine=True, RefineAngle=0, RelativeTolerance=0.65, SimplePlanes=True, Tolerance=0})
mesh_brep_6 = MeshBrep(
    Brep=brep_11,
    Settings={GridMaxCount=0, GridMinCount=16, JaggedSeams=False, MaxEdgeLength=0, MinEdgeLength=0.0001, MinTolerance=0, Refine=True, RefineAngle=0, RelativeTolerance=0.65, SimplePlanes=True, Tolerance=0})
mesh_brep_7 = MeshBrep(
    Brep=brep_10,
    Settings={GridMaxCount=0, GridMinCount=16, JaggedSeams=False, MaxEdgeLength=0, MinEdgeLength=0.0001, MinTolerance=0, Refine=True, RefineAngle=0, RelativeTolerance=0.65, SimplePlanes=True, Tolerance=0})
number_slider = Slider(1, range=0..1)

mesh_brep_8 = MeshBrep(
    Brep=brep_5,
    Settings={GridMaxCount=0, GridMinCount=16, JaggedSeams=False, MaxEdgeLength=0, MinEdgeLength=0.0001, MinTolerance=0, Refine=True, RefineAngle=0, RelativeTolerance=0.65, SimplePlanes=True, Tolerance=0})
mesh_brep_9 = MeshBrep(
    Brep=brep_3,
    Settings={GridMaxCount=0, GridMinCount=16, JaggedSeams=False, MaxEdgeLength=0, MinEdgeLength=0.0001, MinTolerance=0, Refine=True, RefineAngle=0, RelativeTolerance=0.65, SimplePlanes=True, Tolerance=0})
mesh_brep_10 = MeshBrep(
    Brep=brep_6,
    Settings={GridMaxCount=0, GridMinCount=16, JaggedSeams=False, MaxEdgeLength=0, MinEdgeLength=0.0001, MinTolerance=0, Refine=True, RefineAngle=0, RelativeTolerance=0.65, SimplePlanes=True, Tolerance=0})
mesh_brep_11 = MeshBrep(
    Brep=brep_2,
    Settings={GridMaxCount=0, GridMinCount=16, JaggedSeams=False, MaxEdgeLength=0, MinEdgeLength=0.0001, MinTolerance=0, Refine=True, RefineAngle=0, RelativeTolerance=0.65, SimplePlanes=True, Tolerance=0})
simple_mesh = SimpleMesh(Brep=brep_4)
mesh_brep_12 = MeshBrep(
    Brep=brep,
    Settings={GridMaxCount=0, GridMinCount=16, JaggedSeams=False, MaxEdgeLength=0, MinEdgeLength=0.0001, MinTolerance=0, Refine=True, RefineAngle=0, RelativeTolerance=0.65, SimplePlanes=True, Tolerance=0})
mesh_brep_13 = MeshBrep(
    Brep=brep_16,
    Settings={GridMaxCount=0, GridMinCount=16, JaggedSeams=False, MaxEdgeLength=0, MinEdgeLength=0.0001, MinTolerance=0, Refine=True, RefineAngle=0, RelativeTolerance=0.65, SimplePlanes=True, Tolerance=0})
mesh_brep_14 = MeshBrep(
    Brep=brep_15,
    Settings={GridMaxCount=0, GridMinCount=16, JaggedSeams=False, MaxEdgeLength=0, MinEdgeLength=0.0001, MinTolerance=0, Refine=True, RefineAngle=0, RelativeTolerance=0.65, SimplePlanes=True, Tolerance=0})
mesh_brep_15 = MeshBrep(
    Brep=brep_14,
    Settings={GridMaxCount=0, GridMinCount=16, JaggedSeams=False, MaxEdgeLength=0, MinEdgeLength=0.0001, MinTolerance=0, Refine=True, RefineAngle=0, RelativeTolerance=0.65, SimplePlanes=True, Tolerance=0})
mesh_join = MeshJoin(Meshes=mesh_brep_9)
mesh_join_2 = MeshJoin(Meshes=mesh_brep_11)
mesh_join_3 = MeshJoin(Meshes=mesh_brep_8)
mesh_join_4 = MeshJoin(Meshes=mesh_brep_10)
mesh_join_5 = MeshJoin(Meshes=mesh_brep_13)
mesh_join_6 = MeshJoin(Meshes=mesh_brep_14)
brep_17 = Brep(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)
merge = Merge(Data1=simple_mesh, Data2=mesh_join_3, Data3=mesh_join_4)
merge_2 = Merge(Data1=mesh_brep_12, Data2=mesh_join_2, Data3=mesh_join)
simple_mesh_2 = SimpleMesh(Brep=brep_17)
merge_3 = Merge(Data1=mesh_brep_15, Data2=mesh_join_6, Data3=mesh_join_5)
geometry = Geometry(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)
geometry_2 = Geometry(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)
point = Point([Point(-25, 27.5, 1.5), Point(-16, 24.5, 1.575)])
curve = Curve([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])
point_2 = Point([Point(-41.5, 23, 1.5), Point(-46, 27.5, 1.5)])
curve_2 = Curve([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])
geometry_3 = Geometry(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)
point_3 = Point([Point(-32.5, 26, 1.5), Point(-34, 24.5, 1.5), Point(-32.5, 23, 1.5), Point(-31, 24.5, 1.5)])
curve_3 = Curve([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])
geometry_4 = Geometry(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)
curve_4 = Curve([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])
point_4 = Point([Point(-10, 24.5, 1.5), Point(-4, 24.5, 1.5)])
attribute = Wasp_Attribute(ID="detail", VAL=merge, TR=Toggle(True))  # -> ATTR; inputs VAL: list, TR: Boolean; plug-in component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
attribute_2 = Wasp_Attribute(ID="detail", VAL=merge_2, TR=Toggle(True))  # -> ATTR; inputs VAL: list, TR: Boolean; plug-in component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
attribute_3 = Wasp_Attribute(ID="detail", VAL=merge_3, TR=Toggle(True))  # -> ATTR; inputs VAL: list, TR: Boolean; plug-in component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
attribute_4 = Wasp_Attribute(ID="detail", VAL=simple_mesh_2, TR=Toggle(True))  # -> ATTR; inputs VAL: list, TR: Boolean; plug-in component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
point_list = PointList(Points=point, Size=number_slider)
point_list_2 = PointList(Points=point_2, Size=number_slider)
point_list_3 = PointList(Points=point_3, Size=number_slider)
point_list_4 = PointList(Points=point_4, Size=number_slider)
panel = Panel("""B
B""")
panel_2 = Panel("""A
A""")
panel_3 = Panel("""A
A
A
A""")
panel_4 = Panel("""B
B""")
conndir = Wasp_ConnectionFromDirection(GEO=geometry, CEN=point, UP=curve, T=panel)  # -> CONN, PLN_OUT; inputs CEN: list of Point3d, UP: list of Curve, T: list; plug-in component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
conndir_2 = Wasp_ConnectionFromDirection(GEO=geometry_2, CEN=point_2, UP=curve_2, T=panel_2)  # -> CONN, PLN_OUT; inputs CEN: list of Point3d, UP: list of Curve, T: list; plug-in component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
conndir_3 = Wasp_ConnectionFromDirection(GEO=geometry_3, CEN=point_3, UP=curve_3, T=panel_3)  # -> CONN, PLN_OUT; inputs CEN: list of Point3d, UP: list of Curve, T: list; plug-in component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
conndir_4 = Wasp_ConnectionFromDirection(GEO=geometry_4, CEN=point_4, UP=curve_4, T=panel_4)  # -> CONN, PLN_OUT; inputs CEN: list of Point3d, UP: list of Curve, T: list; plug-in component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
advpart = Wasp_AdvancedPart(NAME="corridor2", GEO=geometry, CONN=flatten(conndir.CONN), ATTR=attribute_2)  # -> PART; inputs GEO: Mesh, CONN: list, HI: list, ATTR: list, SUP: list, AEC: list, OC: list; plug-in component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
advpart_2 = Wasp_AdvancedPart(NAME="corridor4", GEO=geometry_2, CONN=flatten(conndir_2.CONN), ATTR=attribute_3)  # -> PART; inputs GEO: Mesh, CONN: list, HI: list, ATTR: list, SUP: list, AEC: list, OC: list; plug-in component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
advpart_3 = Wasp_AdvancedPart(NAME="corridor", GEO=geometry_4, CONN=flatten(conndir_4.CONN), ATTR=attribute)  # -> PART; inputs GEO: Mesh, CONN: list, HI: list, ATTR: list, SUP: list, AEC: list, OC: list; plug-in component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
advpart_4 = Wasp_AdvancedPart(NAME="corridor3", GEO=geometry_3, CONN=flatten(conndir_3.CONN), ATTR=attribute_4)  # -> PART; inputs GEO: Mesh, CONN: list, HI: list, ATTR: list, SUP: list, AEC: list, OC: list; plug-in component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

mesh_join_7 = MeshJoin(Meshes=mesh_brep)
mesh_join_8 = MeshJoin(Meshes=mesh_brep_2)
mesh_join_9 = MeshJoin(Meshes=mesh_brep_3)
mesh_join_10 = MeshJoin(Meshes=mesh_brep_4)
mesh_join_11 = MeshJoin(Meshes=mesh_brep_5)
mesh_join_12 = MeshJoin(Meshes=mesh_brep_6)
mesh_join_13 = MeshJoin(Meshes=mesh_brep_7)
merge_4 = Merge(Data1=mesh_join_9, Data2=mesh_join_8, Data3=mesh_join_7)
merge_5 = Merge(Data1=mesh_join_13, Data2=mesh_join_12, Data3=mesh_join_11, Data4=mesh_join_10)
geometry_5 = Geometry(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)
curve_5 = Curve([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])
point_5 = Point([Point(39, 24.5, 1.5), Point(52.5, 23, 4.5), Point(54, 24.5, 4.5), Point(52.5, 26, 4.5)])
geometry_6 = Geometry(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)
curve_6 = Curve([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])
point_6 = Point([Point(27, 24.58758083, 1.587580826), Point(27, 24.5, 4.5)])
attribute_5 = Wasp_Attribute(ID="detail", VAL=merge_4, TR=Toggle(True))  # -> ATTR; inputs VAL: list, TR: Boolean; plug-in component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
attribute_6 = Wasp_Attribute(ID="detail", VAL=merge_5, TR=Toggle(True))  # -> ATTR; inputs VAL: list, TR: Boolean; plug-in component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
point_list_5 = PointList(Points=point_5, Size=number_slider)
point_list_6 = PointList(Points=point_6, Size=number_slider)
panel_5 = Panel("""A
B
B
B""")
panel_6 = Panel("""A
A""")
conndir_5 = Wasp_ConnectionFromDirection(GEO=geometry_5, CEN=point_5, UP=curve_5, T=panel_5)  # -> CONN, PLN_OUT; inputs CEN: list of Point3d, UP: list of Curve, T: list; plug-in component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
conndir_6 = Wasp_ConnectionFromDirection(GEO=geometry_6, CEN=point_6, UP=curve_6, T=panel_6)  # -> CONN, PLN_OUT; inputs CEN: list of Point3d, UP: list of Curve, T: list; plug-in component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
advpart_5 = Wasp_AdvancedPart(NAME="ramp", GEO=geometry_5, CONN=flatten(conndir_5.CONN), ATTR=attribute_5)  # -> PART; inputs GEO: Mesh, CONN: list, HI: list, ATTR: list, SUP: list, AEC: list, OC: list; plug-in component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
advpart_6 = Wasp_AdvancedPart(NAME="elevator", GEO=geometry_6, CONN=flatten(conndir_6.CONN), ATTR=attribute_6)  # -> PART; inputs GEO: Mesh, CONN: list, HI: list, ATTR: list, SUP: list, AEC: list, OC: list; plug-in component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

sitelength = GetInteger(Slider(83, range=0..100), AtLeast=1, AtMost=1, Maximum=2147483647, Minimum=-2147483648, Prompt="0 to 100")
sitebreadth = GetInteger(Slider(80, range=0..100), AtLeast=1, AtMost=1, Maximum=2147483647, Minimum=-2147483648, Prompt="0 to 100")
siteheight = GetInteger(Slider(43, range=0..100), AtLeast=1, AtMost=1, Maximum=2147483647, Minimum=-2147483648, Prompt="0 to 100")
negative = Negative(Value=sitebreadth)
negative_2 = Negative(Value=sitelength)
construct_point = ConstructPoint(XCoordinate="0", YCoordinate="0", ZCoordinate="0")
construct_domain = ConstructDomain(DomainStart=negative_2, DomainEnd=sitelength)
construct_domain_2 = ConstructDomain(DomainStart=negative, DomainEnd=sitebreadth)
xy_plane = XYPlane(Origin=construct_point)
value_list = ValueList({"x-axis": 0, "y-axis": 1, "z-axis": 2}, selected="x-axis")
value_list_2 = ValueList({"One": 0, "Two": 1, "Three": 2}, selected="Two")
domain_box = DomainBox(Base=xy_plane, X=construct_domain, Y=construct_domain_2, Z=siteheight)
volume = Volume(Geometry=domain_box)  # -> Volume, Centroid
xyzaxis = GetInteger(Slider(0, range=0..2), AtLeast=1, AtMost=1, Maximum=2147483647, Minimum=-2147483648, Prompt="0,1 & 2")
fieldpts = Wasp_FieldPoints(BOU=domain_box, RES=Slider(9.9, range=0..10))  # -> E_FIELD, PTS; inputs BOU: list of Mesh, PLN: Plane; plug-in component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
shiftsides = GetInteger(Slider(2, range=0..2), AtLeast=1, AtMost=1, Maximum=2147483647, Minimum=-2147483648, Prompt="0,1 & 2")
point_7 = Point(fieldpts.PTS)
deconstruct = Deconstruct(Point=point_7)  # -> XComponent, YComponent, ZComponent
pull_point = PullPoint(Point=point_7, Geometry=volume.Centroid, ClosestOnly=True)  # -> ClosestPoint, Distance
stream_filter = StreamFilter(Gate=xyzaxis, Stream0=deconstruct.XComponent, Stream1=deconstruct.YComponent, Stream2=deconstruct.ZComponent)
bounds = Bounds(Numbers=stream_filter)
bounds_2 = Bounds(Numbers=stream_filter)
bounds_3 = Bounds(Numbers=pull_point.Distance)
construct_domain_3 = ConstructDomain(DomainStart=Slider(0, range=0..1), DomainEnd=Slider(1, range=0..1))
remap_numbers = RemapNumbers(Value=stream_filter, Source=bounds, Target="0 to 1")  # -> Mapped, Clipped
remap_numbers_2 = RemapNumbers(Value=stream_filter, Source=bounds_2, Target="1 to 0")  # -> Mapped, Clipped
remap_numbers_3 = RemapNumbers(Value=pull_point.Distance, Source=bounds_3, Target=construct_domain_3)  # -> Mapped, Clipped
graph_mapper = GraphMapper(
    remap_numbers_3.Mapped,
    x0=0,
    x1=1,
    y0=0,
    y1=1,
    container_name="Bezier",
    cpx=[0, 0.9869508743, 0.01401508693, 1],
    cpy=[0, 0, 1, 1])
multiplication = Multiplication(A=graph_mapper, B=remap_numbers.Mapped)
multiplication_2 = Multiplication(A=graph_mapper, B=remap_numbers_2.Mapped)
stream_filter_2 = StreamFilter(Gate=shiftsides, Stream0=graph_mapper, Stream1=multiplication, Stream2=multiplication_2)
gradient = Gradient(
    LowerLimit=0,
    UpperLimit=1,
    Parameter=stream_filter_2,
    stops=[0: RGB(0, 128, 0), 0.5: RGB(255, 255, 0), 1: RGB(255, 0, 0)])
custom_preview = CustomPreview(Geometry=point_7, Material=gradient)

merge_6 = Merge(Data1=advpart_3, Data2=advpart, Data3=advpart_4, Data4=advpart_2, Data5=advpart_6, Data6=advpart_5)
panel_7 = Panel("""A>B
B>B""")
rulegen = Wasp_RulesGenerator(PART=merge_6, GR=panel_7)  # -> R; inputs PART: list, SELF_P: Boolean, SELF_C: Boolean, TYP: Boolean, GR: list; plug-in component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
numberofparts = GetInteger(Slider(296, range=0..1000), AtLeast=1, AtMost=1, Maximum=2147483647, Minimum=-2147483648, Prompt="0 to 100")
field = Wasp_Field(NAME="f1", E_FIELD=fieldpts.E_FIELD, VAL=stream_filter_2)  # -> FIELD; inputs VAL: list; plug-in component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
fieldaggregation = Wasp_FieldDrivenAggregation(PART=flatten(merge_6), N=numberofparts, RULES=rulegen, FIELD=field, MODE=0, RESET=Button())  # -> AGGR, PART_OUT; inputs PART: list, PREV: list, N: Int32, RULES: list, FIELD: list, MODE: Int32, GC: list, RESET: Boolean; plug-in component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
panel_8 = Panel("corridor3")
namefilter = Wasp_FilterPartsByName(PART=fieldaggregation.PART_OUT, NAME="corridor")  # -> PART_OUT, MASK; inputs PART: list, NAME: list; plug-in component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
namefilter_2 = Wasp_FilterPartsByName(PART=fieldaggregation.PART_OUT, NAME="corridor2")  # -> PART_OUT, MASK; inputs PART: list, NAME: list; plug-in component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
namefilter_3 = Wasp_FilterPartsByName(PART=fieldaggregation.PART_OUT, NAME=fieldaggregation.PART_OUT)  # -> PART_OUT, MASK; inputs PART: list, NAME: list; plug-in component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
namefilter_4 = Wasp_FilterPartsByName(PART=fieldaggregation.PART_OUT, NAME="corridor4")  # -> PART_OUT, MASK; inputs PART: list, NAME: list; plug-in component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
namefilter_5 = Wasp_FilterPartsByName(PART=fieldaggregation.PART_OUT, NAME="elevator")  # -> PART_OUT, MASK; inputs PART: list, NAME: list; plug-in component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
namefilter_6 = Wasp_FilterPartsByName(PART=fieldaggregation.PART_OUT, NAME="ramp")  # -> PART_OUT, MASK; inputs PART: list, NAME: list; plug-in component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
value_list_3 = ValueList({"Block": 0, "Detailed": 1}, selected="Detailed")
getattr = Wasp_GetAttributeByName(PART=namefilter.PART_OUT, ID="detail")  # -> VAL; plug-in component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
partgeo = Wasp_GetPartGeometry(PART=namefilter.PART_OUT)  # -> GEO; plug-in component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
getattr_2 = Wasp_GetAttributeByName(PART=namefilter_2.PART_OUT, ID="detail")  # -> VAL; plug-in component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
partgeo_2 = Wasp_GetPartGeometry(PART=namefilter_2.PART_OUT)  # -> GEO; plug-in component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
getattr_3 = Wasp_GetAttributeByName(PART=namefilter_3.PART_OUT, ID="detail")  # -> VAL; plug-in component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
partgeo_3 = Wasp_GetPartGeometry(PART=namefilter_3.PART_OUT)  # -> GEO; plug-in component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
getattr_4 = Wasp_GetAttributeByName(PART=namefilter_4.PART_OUT, ID="detail")  # -> VAL; plug-in component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
partgeo_4 = Wasp_GetPartGeometry(PART=namefilter_4.PART_OUT)  # -> GEO; plug-in component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
getattr_5 = Wasp_GetAttributeByName(PART=namefilter_5.PART_OUT, ID="detail")  # -> VAL; plug-in component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
partgeo_5 = Wasp_GetPartGeometry(PART=namefilter_5.PART_OUT)  # -> GEO; plug-in component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
getattr_6 = Wasp_GetAttributeByName(PART=namefilter_6.PART_OUT, ID="detail")  # -> VAL; plug-in component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
partgeo_6 = Wasp_GetPartGeometry(PART=namefilter_6.PART_OUT)  # -> GEO; plug-in component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
stream_filter_3 = StreamFilter(Gate=value_list_3, Stream0=partgeo, Stream1=getattr)
stream_filter_4 = StreamFilter(Gate=value_list_3, Stream0=partgeo_2, Stream1=getattr_2)
stream_filter_5 = StreamFilter(Gate=value_list_3, Stream0=partgeo_3, Stream1=getattr_3)
stream_filter_6 = StreamFilter(Gate=value_list_3, Stream0=partgeo_4, Stream1=getattr_4)
stream_filter_7 = StreamFilter(Gate=value_list_3, Stream0=partgeo_5, Stream1=getattr_5)
stream_filter_8 = StreamFilter(Gate=value_list_3, Stream0=partgeo_6, Stream1=getattr_6)

# ---- group: RH_OUT:corridor
geometry_7 = Geometry(stream_filter_3)

# ---- group: RH_OUT:corridor2
geometry_8 = Geometry(stream_filter_4)

# ---- group: RH_OUT:corridor3
geometry_9 = Geometry(stream_filter_5)

# ---- group: RH_OUT:corridor4
geometry_10 = Geometry(stream_filter_6)

# ---- group: RH_OUT:elevator
geometry_11 = Geometry(stream_filter_7)

# ---- group: RH_OUT:ramp
geometry_12 = Geometry(stream_filter_8)
